# Grasshopper definition test_convert.ghx (Grasshopper 1.0.7)

genes = GenePool(
    Decimals=2,
    Maximum=100,
    Minimum=0,
    Value=[91.93407436, 40.32887148, 55.72606509, 0.2815656365, 32.82623861, 55.97217705, 48.36667606, 73.36504491, 97.66463586, 40.29566578, 84.89081561, 10.4739972, 34.18905951, 81.05439669, 29.01095828, 1.304353681, 89.57151686, 6.863997787, 55.15053489, 78.84381031, 29.78121714, 72.51875232, 58.46894288, 23.74826624, 63.2045389, 33.74738131, 67.70015306, 35.29813906, 51.6063561, 92.92414244])
item = ListItem(List=genes, Index=0, Wrap=True)  # -> Item, Item1, Item2, Item3, Item4, Item5, Item6, Item7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
pt = ConstructPoint(XCoordinate=item.Item, YCoordinate=item.Item1, ZCoordinate=item.Item2)
pt_2 = ConstructPoint(XCoordinate=item.Item3, YCoordinate=item.Item4, ZCoordinate=item.Item5)
pt_3 = ConstructPoint(XCoordinate=item.Item6, YCoordinate=item.Item7, ZCoordinate=item.Item8)
pt_4 = ConstructPoint(XCoordinate=item.Item9, YCoordinate=item.Item10, ZCoordinate=item.Item11)
pt_5 = ConstructPoint(XCoordinate=item.Item12, YCoordinate=item.Item13, ZCoordinate=item.Item14)
pt_6 = ConstructPoint(XCoordinate=item.Item15, YCoordinate=item.Item16, ZCoordinate=item.Item17)
pt_7 = ConstructPoint(XCoordinate=item.Item18, YCoordinate=item.Item19, ZCoordinate=item.Item20)
pt_8 = ConstructPoint(XCoordinate=item.Item21, YCoordinate=item.Item22, ZCoordinate=item.Item23)
pt_9 = ConstructPoint(XCoordinate=item.Item24, YCoordinate=item.Item25, ZCoordinate=item.Item26)
pt_10 = ConstructPoint(XCoordinate=item.Item27, YCoordinate=item.Item28, ZCoordinate=item.Item29)
ln = Line(StartPoint=pt, EndPoint=pt_2)
box = Box({Plane=Plane(origin=(-27.38290012, -22.64838355, 0), x=(0, 1, 0), y=(1, 0, 0)), X=Domain(0, 22.2213603), Y=Domain(0, 19.55690985), Z=Domain(-23.61474173, 0)})
python = GhPythonScript()  # -> out, rhino_box, rhino_line, rhino_mesh, rhino_plane_from_plane, rhino_plane_from_frame, rhino_point_from_point, rhino_vector_from_point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
# ---------- python: Python ----------
from random import random as r

from compas import get_bunny
import compas.geometry as cg
from compas.datastructures import Mesh
from compas_ghpython.utilities import unload_modules
import Rhino.Geometry as rg
unload_modules("compas_convert")

from compas_convert import convert

def get_pt():
    return cg.Point(r()*50, r()*50, r()*50)

def get_v():
    return cg.Vector(r(), r(), r())

def get_frame():
    return cg.Frame(get_pt(), get_v(), get_v())

rhino_box = convert(cg.Box(get_frame(), r()*50, r()*50, r()*50))
rhino_line = convert(cg.Line(get_pt(), get_pt()))
rhino_mesh = convert(Mesh.from_ply(get_bunny()))
rhino_plane_from_plane = convert(cg.Plane(get_pt(), get_v()))
rhino_plane_from_frame = convert(get_frame())
rhino_point_from_point = convert(get_pt(), to=rg.Point3d)
rhino_vector_from_point = convert(get_pt(), to=rg.Vector3d)
rhino_point_from_vector = convert(get_v(), to=rg.Point3d)
rhino_vector_from_vector = convert(get_v(), to=rg.Vector3d)
rhino_transform_from_list = convert(cg.Translation.from_vector(get_v()).matrix)
rhino_transform_from_transform = convert(cg.Translation.from_vector(get_v()))
# ---------- end python ----------
pl = ConstructPlane(Origin=pt_8, XAxis=pt_9, YAxis=pt_10)
vec = Vector(pt_4)
pl_2 = ConstructPlane(Origin=pt_5, XAxis=pt_6, YAxis=pt_7)
mesh = MeshBrep(
    Brep=box,
    Settings={GridMaxCount=0, GridMinCount=16, JaggedSeams=False, MaxEdgeLength=0, MinEdgeLength=0.0001, MinTolerance=0, Refine=True, RefineAngle=0, RelativeTolerance=0.65, SimplePlanes=True, Tolerance=0})
move = Move(Motion=vec)  # -> Geometry, Transform
orient = Orient(Source=pl_2, Target=pl)  # -> Geometry, Transform
comp = Compound(Transforms=[orient.Transform, move.Transform])
box_2 = Box(python.rhino_box)
line = Line(python.rhino_line)
pln = Plane(python.rhino_plane_from_plane)
pt_11 = Point(python.rhino_point_from_point)
vec_2 = Vector(python.rhino_vector_from_point)
mesh_2 = Mesh(python.rhino_mesh)
pt_12 = Point(python.rhino_point_from_vector)
transform = Transform(python.rhino_transform_from_list)
pln_2 = Plane(python.rhino_plane_from_frame)
vec_3 = Vector(python.rhino_vector_from_vector)
null = NullItem(Item=[box_2, line, mesh_2, pln, pln_2, pt_11, vec_2, pt_12, vec_3, transform])  # -> NullFlags, InvalidFlags, Description
pln_3 = Plane(Plane(origin=(35.45923112, 49.79874535, 24.11761828), x=(0.6000541633, 0.6649201745, 0.4447652894), y=(-0.7926638082, 0.419294705, 0.4425788489)))
vec_4 = Vector(Vector(0.5183269111, 0.6860182606, 0.2793195762))
python_2 = GhPythonScript(box=box, line=ln, mesh=mesh, plane=pl_2, point=pt_3, vector=vec, transform=comp)  # -> out, compas_box, compas_line, compas_mesh, compas_plane, compas_frame, compas_point_from_point, compas_vector_from_point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; inputs transform: Transform
# ---------- python_2: Python ----------
from compas_ghpython.utilities import unload_modules

unload_modules("compas_convert")

import compas.geometry as cg

from compas_convert.smart_converter import convert
print(type(box))
compas_box = convert(box)
compas_line = convert(line)
compas_mesh = convert(mesh)
compas_plane = convert(plane, to=cg.Plane)
compas_frame = convert(plane)
compas_point_from_point = convert(point)
compas_vector_from_point = convert(point, to=cg.Vector)
compas_vector_from_vector = convert(vector)
compas_point_from_vector = convert(vector, to=cg.Point)
compas_transform = str(convert(transform))
# ---------- end python_2 ----------
cset = CreateSet(List=[null.InvalidFlags, null.NullFlags])  # -> Set, Map
panel = Panel(pln_3)
panel_2 = Panel(vec_4)
convert = UniversalObjectConverter(input=pln_3)  # -> output
#   port input: Input object.
#   port output: Output object.
# ---------- convert: Python ----------
"""
Convert compas object to Rhino object.
compas_convert 0.1.0
"""
from ghpythonlib.componentbase import executingcomponent as component

from compas_convert import convert


class ConvertComponent(component):
    def RunScript(self, input):
        output = None
        if input:
            output = convert(input)

        return output
# ---------- end convert ----------
convert_2 = UniversalObjectConverter(input=vec_4)  # -> output; same code as convert
panel_3 = Panel(cset.Set)
convert_3 = UniversalObjectConverter(input=convert)  # -> output; same code as convert
python_3 = GhPythonScript(obj=convert_2)  # -> obj_type
# ---------- python_3: Python ----------
obj_type = obj.dtype
# ---------- end python_3 ----------
python_4 = GhPythonScript(obj=convert)  # -> obj_type; same code as python_3
convert_4 = UniversalObjectConverter(input=convert_2)  # -> output; same code as convert
python_5 = GhPythonScript(obj=python_2.compas_box)  # -> obj_type; same code as python_3
python_6 = GhPythonScript(obj=python_2.compas_line)  # -> obj_type; same code as python_3
python_7 = GhPythonScript(obj=python_2.compas_mesh)  # -> obj_type; same code as python_3
python_8 = GhPythonScript(obj=python_2.compas_plane)  # -> obj_type; same code as python_3
python_9 = GhPythonScript(obj=python_2.compas_frame)  # -> obj_type; same code as python_3
python_10 = GhPythonScript(obj=python_2.compas_point_from_point)  # -> obj_type; same code as python_3
python_11 = GhPythonScript(obj=python_2.compas_vector_from_point)  # -> obj_type; same code as python_3
python_12 = GhPythonScript(obj=python_2.compas_vector_from_vector)  # -> obj_type; same code as python_3
python_13 = GhPythonScript(obj=python_2.compas_point_from_vector)  # -> obj_type; same code as python_3
convert_5 = UniversalObjectConverter(input=[convert, convert_3, convert_4])  # -> output
#   port input: Input object.
#   port output: Output object.
# ---------- convert_5: Python ----------
"""
Convert compas object to Rhino object.
compas_convert 0.1.2.6
"""
from ghpythonlib.componentbase import executingcomponent as component

from compas_convert import convert


class ConvertComponent(component):
    def RunScript(self, input):
        output = None
        if input:
            output = convert(input)

        return output
# ---------- end convert_5 ----------
panel_4 = Panel(python_3)
panel_5 = Panel(python_4)
panel_6 = Panel(python_6)
panel_7 = Panel(python_10)
panel_8 = Panel(python_11)
panel_9 = Panel(python_5)
panel_10 = Panel(python_7)
panel_11 = Panel(python_8)
panel_12 = Panel(python_9)
panel_13 = Panel(python_12)
panel_14 = Panel(python_13)
panel_15 = Panel(python_2.compas_transform)
pln_4 = Plane(convert_3)
vec_5 = Vector(convert_4)
panel_16 = Panel(pln_4)
panel_17 = Panel(vec_5)
